# Requirement set stakeholder-requirements (R2023a)

Attributes:
- Review status: Imported from Excel:Review status
- Trace backward: Imported from Excel:Trace backward

## 1 [#15] Stakeholder requirements (Container)

### 1.1 [#16] The door control system shall know which doors to open.

### 1.2 [#18] The door control system shall be able to open all doors on the left

### 1.3 [#19] The door control system shall be able to open all doors on the right

### 1.4 [#20] The door control system shall be able to close all doors.

### 1.5 [#21] The door control system shall be able to open doors selectively

### 1.6 [#22] The door control system shall be able to monitor the door status

### 1.7 [#23] The user shall be able to tell the door control system to open a door

### 1.8 [#24] The door control system shall not close a door if something is in the way

### 1.9 [#25] The maintainer shall be able to maintain update the software

### 1.10 [#26] The door control system shall be accessible in the cockpit

### 1.11 [#27] The door control system shall have a function to save door errors

### 1.12 [#28] The door control system shall be able to lock doors

### 1.13 [#29] The door control system shall only update to authentic software

## 2 [#30] System requirements (Container)

### 2.1 [#32] The door control system shall check door lock status

### 2.2 [#36] When a passenger pushes a open door button, the door control system shall open the corresponding door

### 2.3 [#34] If the door control system gets told to open a locked door, then the door control system shall keep that door closed

### 2.4 [#35] If there is something in the way of a closing door, then the door control system shall open the closing door

### 2.5 [#37] If the door motors draws power over its specified power draw, then the door control system shall stop the closing of the door

### 2.6 [#38] When a door fails to close, the door control system shall light up the door error light

### 2.7 [#39] When a door fails to close, the door control system shall save what door is faulty

### 2.8 [#40] When the train operator pushes the close all doors on the left button, the door control system shall close all doors on the left

### 2.9 [#41] When the train operator pushes the open all doors on the left, the door control system shall open all doors on the left

### 2.10 [#42] When the train operator pushes the close all doors on the right, the door control system shall close all doors on the right

### 2.11 [#43] When the train operator pushes the open all doors on the right, the door control system shall open all doors on the right

### 2.12 [#44] When the train operator pushes the open doors selectively button, the door control system shall open the doors facing the platform

### 2.13 [#45] When a door is open the door control system shall keep the “doors open” light turned on

### 2.14 [#46] When all doors are closed the “doors open” light shall turn off the door open light

### 2.15 [#47] The door control system shall be accessible with a usb cable

### 2.16 [#48] The door control system shall be able to have its software updated

### 2.17 [#49] If a non-authentic software update gets uploaded, then the door control system shall reject the software

### 2.18 [#50] When a authentic software update gets uploaded, the door control system shall update to that software

### 2.19 [#51] When the train operator pushes the lock doors button, the door control system shall lock the doors

### 2.20 [#52] If the train is moving, then the door control system shall keep the doors locked

### 2.21 [#53] When the train operator pushes the unlock doors button, the door control system shall unlock the doors

### 2.22 [#54] If a door is open and the door control system tries to lock the doors, then the door control system does not lock the doors

### 2.23 [#55] If the train doors are not set to operational, then the door control system shall not move the doors